# Dynamo graph dynamo_test.dyn (Dynamo 2.18.1.5096)

python_script = Python()  # CPython3; unwired: IN[0]
# ---------- python_script.python (12 lines) ----------
import clr
import System
clr.AddReference('RevitAPI')
clr.AddReference("RevitServices")
import RevitServices
import re 
from RevitServices.Persistence import DocumentManager
from Autodesk.Revit.DB import *
from System.Collections.Generic import List

doc = DocumentManager.Instance.CurrentDBDocument
OUT = doc
# ----------------------------------------
roomBounding = HVACLoadTerminals.Utils.RoomBounding.RoomBounding(doc=python_script)
faceDataList = HVACLoadTerminals.Utils.RoomBounding.FaceDataList(roomBounding=roomBounding)
python_script_2 = Python(IN[0]=faceDataList)  # CPython3
# ---------- python_script_2.python (31 lines) ----------
import clr

# Import RevitAPI
clr.AddReference("RevitAPI")
import Autodesk

clr.AddReference("RevitNodes")
import Revit

# Import DocumentManager and TransactionManager
clr.AddReference("RevitServices")
import RevitServices
from RevitServices.Persistence import DocumentManager
from RevitServices.Transactions import TransactionManager

# Import geometry conversion extension methods
clr.ImportExtensions(Revit.GeometryConversion)

# Import Element wrapper extension methods
clr.ImportExtensions(Revit.Elements)
_faces =UnwrapElement(IN[0])
faces_list =[]

for face_data in _faces:
    try:
        geom = face_data._Face
        faces_list.append(geom)
    except:
        pass

OUT = faces_list
# ----------------------------------------
